# Grasshopper definition P2112 Global definition 05.gh (Grasshopper 1.0.7)
# plug-ins: EleFront, Karamba3D

offset_in_x_dir = Panel("15000")
offset_in_x_dir_2 = Panel("15000")

pt = Point(<point referenced from the Rhino model>)
crv = Curve([<curve referenced from the Rhino model> x12])
crv_2 = Curve([<curve referenced from the Rhino model> x12])
crv_3 = Curve([<curve referenced from the Rhino model> x5])
crv_4 = Curve([<curve referenced from the Rhino model> x12])
pt_2 = Point([<point referenced from the Rhino model> x11])

pt_3 = Point(<point referenced from the Rhino model>)
crv_5 = Curve([<curve referenced from the Rhino model> x7])
crv_6 = Curve([<curve referenced from the Rhino model> x6])
crv_7 = Curve([<curve referenced from the Rhino model> x5])
crv_8 = Curve([<curve referenced from the Rhino model> x7])
pt_4 = Point([<point referenced from the Rhino model> x4])
crv_9 = Curve(<curve referenced from the Rhino model>)

# ----
# PROCESS GRIDLINES 1
crv_10 = Curve(crv)
crv_11 = Curve(crv_3)
crv_12 = Curve(crv_2)
pt_5 = Point(pt)
data = Data(offset_in_x_dir)
end = EndPoints(Curve=crv_10)  # -> Start, End
end_2 = EndPoints(Curve=crv_11)  # -> Start, End
end_3 = EndPoints(Curve=crv_12)  # -> Start, End
pdecon = Deconstruct(Point=end.Start)  # -> XComponent, YComponent, ZComponent
pdecon_2 = Deconstruct(Point=end_2.Start)  # -> XComponent, YComponent, ZComponent
pdecon_3 = Deconstruct(Point=end_3.Start)  # -> XComponent, YComponent, ZComponent
X = UnitX(Factor=1)
sort = SortList(Keys=pdecon.XComponent, ValuesA=crv_10)  # -> Keys, ValuesA
sort_2 = SortList(Keys=pdecon_2.YComponent, ValuesA=crv_11)  # -> Keys, ValuesA
sort_3 = SortList(Keys=pdecon_3.ZComponent, ValuesA=crv_12)  # -> Keys, ValuesA
rot3d = Rotate3D(Geometry=sort_3.ValuesA, Angle=1.570796327, Center=pt_5, Axis=X)  # -> Geometry, Transform
X_2 = UnitX(Factor=data)
move = Move(Geometry=sort.ValuesA, Motion=X_2)  # -> Geometry, Transform
move_2 = Move(Geometry=sort_2.ValuesA, Motion=X_2)  # -> Geometry, Transform
move_3 = Move(Geometry=rot3d.Geometry, Motion=X_2)  # -> Geometry, Transform
move_4 = Move(Motion=X_2)  # -> Geometry, Transform
item = ListItem(List=rot3d.Transform, Index=0, Wrap=True)
comp = Compound(Transforms=[item, move_4.Transform])
transform = Transform(comp)
gr_long = Curve(move_2.Geometry)
gr_tran = Curve(move.Geometry)
gr_vert = Curve(move_3.Geometry)

# ----
# PROCESS GRIDLINES 2
crv_13 = Curve(crv_5)
crv_14 = Curve(crv_7)
crv_15 = Curve(crv_6)
pt_6 = Point(pt_3)
data_2 = Data(offset_in_x_dir_2)
end_4 = EndPoints(Curve=crv_13)  # -> Start, End
end_5 = EndPoints(Curve=crv_14)  # -> Start, End
end_6 = EndPoints(Curve=crv_15)  # -> Start, End
pdecon_4 = Deconstruct(Point=end_4.Start)  # -> XComponent, YComponent, ZComponent
pdecon_5 = Deconstruct(Point=end_5.Start)  # -> XComponent, YComponent, ZComponent
pdecon_6 = Deconstruct(Point=end_6.Start)  # -> XComponent, YComponent, ZComponent
X_3 = UnitX(Factor=1)
sort_4 = SortList(Keys=pdecon_4.XComponent, ValuesA=crv_13)  # -> Keys, ValuesA
sort_5 = SortList(Keys=pdecon_5.YComponent, ValuesA=crv_14)  # -> Keys, ValuesA
sort_6 = SortList(Keys=pdecon_6.ZComponent, ValuesA=crv_15)  # -> Keys, ValuesA
rot3d_2 = Rotate3D(Geometry=sort_6.ValuesA, Angle=1.570796327, Center=pt_6, Axis=X_3)  # -> Geometry, Transform
X_4 = UnitX(Factor=data_2)
move_5 = Move(Geometry=sort_4.ValuesA, Motion=X_4)  # -> Geometry, Transform
move_6 = Move(Geometry=sort_5.ValuesA, Motion=X_4)  # -> Geometry, Transform
move_7 = Move(Geometry=rot3d_2.Geometry, Motion=X_4)  # -> Geometry, Transform
move_8 = Move(Motion=X_4)  # -> Geometry, Transform
item_2 = ListItem(List=rot3d_2.Transform, Index=0, Wrap=True)
comp_2 = Compound(Transforms=[item_2, move_8.Transform])
transform_2 = Transform(comp_2)
gr_long_2 = Curve(move_6.Geometry)
gr_tran_2 = Curve(move_5.Geometry)
gr_vert_2 = Curve(move_7.Geometry)

extension = Panel("1000")
extension_2 = Panel("1000")

# ----
# GENERATE TIERS AND ANCHOR POITNS 1
transform_3 = Transform(transform)
step_tops = Point(pt_2)
gr_long_3 = Curve(gr_long)
concrete_tiers = Curve(crv_4)
tier_extension = Data(extension)
end_7 = EndPoints(Curve=gr_long_3)  # -> Start, End
transform_4 = Transform(Geometry=step_tops, Transform=transform_3)
transform_5 = Transform(Geometry=concrete_tiers, Transform=transform_3)
xz = XZPlane(Origin=end_7.Start)
pt_7 = Point(transform_4)
pdecon_7 = Deconstruct(Point=pt_7)  # -> XComponent, YComponent, ZComponent
crv_16 = Curve(transform_5)
item_3 = ListItem(List=xz, Index=0, Wrap=True)  # -> Item, Item1, Item2, Item3, Item4
sort_7 = SortList(Keys=pdecon_7.ZComponent, ValuesA=pt_7)  # -> Keys, ValuesA
end_8 = EndPoints(Curve=crv_16)  # -> Start, End
pdecon_8 = Deconstruct(Point=end_8.Start)  # -> XComponent, YComponent, ZComponent
Y = UnitY(Factor=tier_extension)
sort_8 = SortList(Keys=pdecon_8.ZComponent, ValuesA=crv_16)  # -> Keys, reverse(ValuesA)
project = Project(Geometry=sort_8.ValuesA, Plane=item_3.Item1)  # -> Geometry, Transform
project_2 = Project(Geometry=sort_8.ValuesA, Plane=item_3.Item3)  # -> Geometry, Transform
project_3 = Project(Geometry=sort_7.ValuesA, Plane=item_3.Item)  # -> Geometry, Transform
project_4 = Project(Geometry=sort_7.ValuesA, Plane=item_3.Item4)  # -> Geometry, Transform
project_5 = Project(Geometry=sort_7.ValuesA, Plane=item_3.Item1)  # -> Geometry, Transform
project_6 = Project(Geometry=sort_7.ValuesA, Plane=item_3.Item3)  # -> Geometry, Transform
neg = Negative(Value=Y)
split = SplitList(List=project.Geometry, Index=1)  # -> ListA, ListB
split_2 = SplitList(List=project_2.Geometry, Index=1)  # -> ListA, ListB
ln = Line(StartPoint=project_3.Geometry, EndPoint=project_4.Geometry)
Z = UnitZ(Factor="10")
panel = Panel("""900
780""")
neg_2 = Negative(Value=Z)
extr = Extrude(Base=project.Geometry, Direction=neg)
extr_2 = Extrude(Base=project_2.Geometry, Direction=Y)
X_5 = UnitX(Factor=panel)
move_9 = Move(Geometry=ln, Motion=neg_2)  # -> Geometry, Transform
loft = Loft(
    Curves=[split.ListA, split_2.ListA],
    Options={Adjust=False, Closed=False, LoftEnds=0, LoftSimp=0, LoftType=0, Rebuild=10, Refit=0.01})
cap = CapHoles(Brep=extr)  # -> reverse(Brep)
cap_2 = CapHoles(Brep=extr_2)  # -> reverse(Brep)
addition = Addition(A=X_5, B=Z)
multiplication = Multiplication(A=2, B=Z)
move_10 = Move(Geometry=move_9.Geometry, Motion=addition)  # -> Geometry, Transform
rulesrf = RuledSurface(CurveA=move_9.Geometry, CurveB=move_10.Geometry)
extr_3 = Extrude(Base=rulesrf, Direction=multiplication)
sdiff = SolidDifference(BrepsA=cap, BrepsB=extr_3)
sdiff_2 = SolidDifference(BrepsA=cap_2, BrepsB=extr_3)
concrete_tiers_2 = Brep(flatten([loft, sdiff, sdiff_2]))
truss_start = Point(project_5.Geometry)
truss_end = Point(project_6.Geometry)

steps = Curve(crv_9)
top_of_step = Curve(move_10.Geometry)
panel_2 = Panel("2")
end_9 = EndPoints(Curve=top_of_step)  # -> Start, End
dist = Distance(PointA=end_9.End, PointB=truss_end)
sort_9 = SortList(Keys=dist)  # -> reverse(Keys), ValuesA
concrete_tiers_3 = Brep(concrete_tiers_2)
item_4 = ListItem(List=sort_9.Keys, Index=0, Wrap=True)
l_st_max = Data(item_4)
layer = DefineLayer(Name="3D::Concrete tiers")
preview = CustomPreview(Geometry=concrete_tiers_3, Material=ColourSwatch(SwatchColor=RGB(171, 171, 171)))
layer_2 = DefineLayer(Name="3D::Concrete tiers")
X_6 = UnitX(Factor=1)
pt_8 = Point(<point referenced from the Rhino model>)
attributes = DefineObjectAttributes(Layer=layer)
attributes_2 = DefineObjectAttributes(Layer=layer_2)
pt_9 = Point(<point referenced from the Rhino model>)
X_7 = UnitX(Factor=1)
bake = BakeObjects(Geometry=concrete_tiers_3, Attributes=attributes, Bake=False)
xy = XYPlane(Origin=pt_9)
xy_2 = XYPlane(Origin=pt_8)
panel_3 = Panel("""500
1400
2300""")
panel_4 = Panel("""20
2780""")
crv_17 = Curve(<curve referenced from the Rhino model>)
crv_18 = Curve(<curve referenced from the Rhino model>)
pframe = PerpFrame(Curve=reparameterize(crv_17), Parameter=0)
addition_2 = Addition(A=panel_3, B="50")
area = Area(Geometry=crv_18)  # -> Area, Centroid
subtraction = Subtraction(A=panel_3, B="50")
panel_5 = Panel("""850
2800-850""")
xy_3 = XYPlane(Origin=area.Centroid)
panel_6 = Panel("""20
2780""")
crv_19 = Curve(<curve referenced from the Rhino model>)
crv_20 = Curve(<curve referenced from the Rhino model>)
crv_21 = Curve(<curve referenced from the Rhino model>)
merge = Merge(Data1=panel_4, Data2=subtraction, Data3=addition_2)
crv_22 = Curve(<curve referenced from the Rhino model>)
crv_23 = Curve(<curve referenced from the Rhino model>)
data_3 = Data(panel_3)
crv_24 = Curve(<curve referenced from the Rhino model>)
crv_25 = Curve(<curve referenced from the Rhino model>)
crv_26 = Curve(<curve referenced from the Rhino model>)
crv_27 = Curve(<curve referenced from the Rhino model>)
crv_28 = Curve(<curve referenced from the Rhino model>)
crv_29 = Curve(<curve referenced from the Rhino model>)
crv_30 = Curve(<curve referenced from the Rhino model>)
offset = OffsetCurve(Curve=crv_18, Distance="-2", Corners=1)
crv_31 = Curve(<curve referenced from the Rhino model>)
crv_32 = Curve(<curve referenced from the Rhino model>)
crv_33 = Curve(<curve referenced from the Rhino model>)
crv_34 = Curve(<curve referenced from the Rhino model>)
addition_3 = Addition(A=panel_5, B="25")
crv_35 = Curve(<curve referenced from the Rhino model>)
subtraction_2 = Subtraction(A=panel_5, B="25")
panel_7 = Panel("""350
700
1050
1400
1750
2100
2450""")
addition_4 = Addition(A="40", B="3")
pt_10 = Point([<point referenced from the Rhino model> x2])
sort_10 = SortList(Keys=merge)  # -> Keys, ValuesA
area_2 = Area(Geometry=crv_24)  # -> Area, Centroid
area_3 = Area(Geometry=crv_27)  # -> Area, Centroid
crv_36 = Curve(<curve referenced from the Rhino model>)
crv_37 = Curve(graft([<curve referenced from the Rhino model> x6]))
crv_38 = Curve([<curve referenced from the Rhino model> x2])
crv_39 = Curve([<curve referenced from the Rhino model> x2])
crv_40 = Curve(<curve referenced from the Rhino model>)
pt_11 = Point([<point referenced from the Rhino model> x4])
addition_5 = Addition(A="40", B="8")
pt_12 = Point(<point referenced from the Rhino model>)
crv_41 = Curve([<curve referenced from the Rhino model> x2])
data_4 = Data(panel_3)
crv_42 = Curve([<curve referenced from the Rhino model> x2])
crv_43 = Curve(<curve referenced from the Rhino model>)
crv_44 = Curve([<curve referenced from the Rhino model> x4])
orient = Orient(Geometry=[crv_18, offset], Source=xy_3, Target=pframe)  # -> Geometry, Transform
merge_2 = Merge(Data1=panel_6, Data2=data_3, Data3=subtraction_2, Data4=addition_3)
crv_45 = Curve([<curve referenced from the Rhino model> x2])
Y_2 = UnitY(Factor=sort_10.Keys)
pframe_2 = PerpFrame(Curve=reparameterize(crv_25), Parameter=0)
xy_4 = XYPlane(Origin=area_2.Centroid)
pframe_3 = PerpFrame(Curve=reparameterize(crv_28), Parameter=0)
xy_5 = XYPlane(Origin=area_3.Centroid)
pt_13 = Point(<point referenced from the Rhino model>)
data_5 = Data(panel_3)
inblock = InsertBlock(BlockName="REDD-XX-Beam", SourcePlane=pt_10)
division = Division(A="40", B=2)
Z_2 = UnitZ(Factor=data_4)
Y_3 = UnitY(Factor="75")
Z_3 = UnitZ(Factor="40")
multiplication_2 = Multiplication(A="15", B=2)
division_2 = Division(A="40", B=2)
swp1 = Sweep1(Rail=crv_17, Sections=orient.Geometry, Miter=1)
sort_11 = SortList(Keys=merge_2)  # -> Keys, ValuesA
X_8 = UnitX(Factor="185")
Y_4 = UnitY(Factor="-25")
neg_3 = Negative(Value=Y_2)
orient_2 = Orient(Geometry=crv_24, Source=xy_4, Target=pframe_2)  # -> Geometry, Transform
X_9 = UnitX(Factor="522")
orient_3 = Orient(Geometry=crv_27, Source=xy_5, Target=pframe_3)  # -> Geometry, Transform
deblock = DeconstructBlock(Block=inblock)  # -> Name, Plane, Geometry
Y_5 = UnitY(Factor="90")
Y_6 = UnitY(Factor="50")
addition_6 = Addition(A=Y_3, B=Z_3)
move_11 = Move(Geometry=pt_12, Motion=Z_2)  # -> Geometry, Transform
Y_7 = UnitY(Factor="50")
crv_46 = Curve(<curve referenced from the Rhino model>)
Y_8 = UnitY(Factor="6")
crv_47 = Curve(<curve referenced from the Rhino model>)
subtraction_3 = Subtraction(A=data_3, B=division)
Y_9 = UnitY(Factor="-145")
panel_8 = Panel("""271
996
1804
2529""")
subtraction_4 = Subtraction(A="2800", B=multiplication_2)
division_3 = Division(A="40", B=2)
Y_10 = UnitY(Factor="25")
shift = ShiftList(List=sort_10.Keys, Shift=1, Wrap=False)
Y_11 = UnitY(Factor="50")
Y_12 = UnitY(Factor=panel_7)
Y_13 = UnitY(Factor="5")
Y_14 = UnitY(Factor=addition_5)
neg_4 = Negative(Value=Y_5)
neg_5 = Negative(Value=Y_6)
neg_6 = Negative(Value=Y_4)
swp1_2 = Sweep1(Rail=crv_25, Sections=orient_2.Geometry, Miter=1)
neg_7 = Negative(Value=Y_7)
neg_8 = Negative(Value=Y_8)
swp1_3 = Sweep1(Rail=crv_28, Sections=orient_3.Geometry, Miter=1)
len = Length(Curve=deblock.Geometry)
subtraction_5 = Subtraction(A=sort_11.Keys, B=division_2)
X_10 = UnitX(Factor="1000")
neg_9 = Negative(Value=Y_9)
Y_15 = UnitY(Factor=subtraction_3)
Y_16 = UnitY(Factor=panel_8)
shift_2 = ShiftList(List=shift, Shift=-1, Wrap=False)
neg_10 = Negative(Value=Y_12)
sort_12 = SortList(Keys=len, ValuesA=deblock.Geometry)  # -> Keys, reverse(ValuesA)
neg_11 = Negative(Value=Y_14)
subtraction_6 = Subtraction(A=data_5, B=division_3)
Z_4 = UnitZ(Factor=subtraction_4)
Z_5 = UnitZ(Factor="15")
neg_12 = Negative(Value=Y_10)
neg_13 = Negative(Value=Y_15)
division_4 = Division(A="16", B=2)
Y_17 = UnitY(Factor=subtraction_5)
neg_14 = Negative(Value=Y_11)
neg_15 = Negative(Value=Y_13)
Z_6 = UnitZ(Factor="60")
Z_7 = UnitZ(Factor="53")
Z_8 = UnitZ(Factor="-13")
partition = PartitionList(List=shift_2, Size="2")
neg_16 = Negative(Value="50")
crv_48 = Curve(<curve referenced from the Rhino model>)
Y_18 = UnitY(Factor=subtraction_6)
neg_17 = Negative(Value=Y_16)
neg_18 = Negative(Value=Y_17)
crv_49 = Curve(<curve referenced from the Rhino model>)
move_12 = Move(Geometry=sort_12.ValuesA, Motion=Z_5)  # -> Geometry, Transform
multiplication_3 = Multiplication(A="50", B=2)
dispatch = Dispatch(List=partition, DispatchPattern=[True, False])  # -> ListA, ListB
neg_19 = Negative(Value=Y_18)
panel_9 = Panel("""1
2
2
2
1""")
extr_4 = Extrude(Base=move_12.Geometry, Direction=Z_4)
subtraction_7 = Subtraction(A=dispatch.ListB, B=dispatch.ListA)
Y_19 = UnitY(Factor=dispatch.ListA)
cap_3 = CapHoles(Brep=extr_4)
neg_20 = Negative(Value=Y_19)
split_3 = SplitList(List=cap_3, Index=1)  # -> ListA, ListB
panel_10 = Panel("""0
1
1
2""")
sdiff_3 = SolidDifference(BrepsA=split_3.ListA, BrepsB=split_3.ListB)  # -> flatten(Result)
X_11 = UnitX(Factor="-5")

# ----
# CONTROLS
path = Slider(1, range=0..3)
mode = Slider(0, range=0..2)
expression = Expression(x=path, Expression="\"{\"&x&\"}\"")

neg_21 = Negative(Value=Slider(1835, range=0..5000))
vec = VectorXYZ(XComponent=Slider(0, range=0..5000), YComponent=Slider(0, range=0..5000), ZComponent=Slider(927, range=0..5000))  # -> Vector, Length
vec_2 = VectorXYZ(XComponent=Slider(0, range=0..5000), YComponent=Slider(0, range=0..5000), ZComponent=Slider(0, range=0..5000))  # -> Vector, Length
vec_3 = VectorXYZ(XComponent=Slider(0, range=0..5000), YComponent=Slider(0, range=0..5000), ZComponent=Slider(0, range=0..5000))  # -> Vector, Length
vec_4 = VectorXYZ(XComponent=Slider(0, range=0..5000), YComponent=Slider(0, range=0..5000), ZComponent=Slider(2115, range=0..5000))  # -> Vector, Length
vec_5 = VectorXYZ(XComponent=Slider(0, range=0..5000), YComponent=Slider(0, range=0..5000), ZComponent=Slider(1455, range=0..5000))  # -> Vector, Length
swatch = ColourSwatch(SwatchColor=RGB(0, 17, 145))
swatch_2 = ColourSwatch(SwatchColor=RGB(186, 214, 211))
swatch_3 = ColourSwatch(SwatchColor=RGB(145, 0, 104))
swatch_4 = ColourSwatch(SwatchColor=RGB(91, 191, 71))
swatch_5 = ColourSwatch(SwatchColor=RGB(145, 0, 0))
swatch_6 = ColourSwatch(SwatchColor=RGB(145, 85, 0))
vec_6 = VectorXYZ(XComponent=neg_21, YComponent=Slider(0, range=0..5000), ZComponent=Slider(0, range=0..5000))  # -> Vector, Length
swatch_7 = ColourSwatch(SwatchColor=RGB(99, 99, 99))
vec_7 = Vector(vec_4.Vector)
swatch_8 = ColourSwatch(SwatchColor=RGB(91, 191, 71))
swatch_9 = ColourSwatch(SwatchColor=RGB(91, 191, 71))
swatch_10 = ColourSwatch(SwatchColor=RGB(110, 108, 0))
layer_3 = DefineLayer(Name="3D::Skamotec", Color=swatch_8)
layer_4 = DefineLayer(Name="3D::Bolts", Color=swatch_10)
layer_5 = DefineLayer(Name="3D::Aluminium", Color=swatch)
layer_6 = DefineLayer(Name="3D::Skamotec", Color=swatch_4)
layer_7 = DefineLayer(Name="3D::Horizontal frame", Color=swatch_3)
layer_8 = DefineLayer(Name="3D::Steel", Color=swatch_6)
attributes_3 = DefineObjectAttributes(Layer=layer_3)
layer_9 = DefineLayer(Name="3D::Attachments", Color=swatch_7)
attributes_4 = DefineObjectAttributes(Layer=layer_5)
layer_10 = DefineLayer(Name="3D::Vertical frame", Color=swatch_5)
layer_11 = DefineLayer(Name="3D::GRP", Color=swatch_2)
attributes_5 = DefineObjectAttributes(Layer=layer_6)
attributes_6 = DefineObjectAttributes(Layer=layer_4)
layer_12 = DefineLayer(Name="3D::Skamotec", Color=swatch_9)
attributes_7 = DefineObjectAttributes(Layer=layer_8)
attributes_8 = DefineObjectAttributes(Layer=layer_7)
attributes_9 = DefineObjectAttributes(Layer=layer_9)
attributes_10 = DefineObjectAttributes(Layer=layer_11)
attributes_11 = DefineObjectAttributes(Layer=layer_12)
attributes_12 = DefineObjectAttributes(Layer=layer_10)
cross_section = CrossSectionKaramba3D(FamilyNameOfCrossSection="DefaultCroSec", Material=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, Height_cm=1, mode="Shell - Const")

# ----
# GENERATE TIERS AND ANCHOR POITNS 2
transform_6 = Transform(transform_2)
step_tops_2 = Point(pt_4)
gr_long_4 = Curve(gr_long_2)
concrete_tiers_4 = Curve(crv_8)
tier_extension_2 = Data(extension_2)
end_10 = EndPoints(Curve=gr_long_4)  # -> Start, End
transform_7 = Transform(Geometry=step_tops_2, Transform=transform_6)
transform_8 = Transform(Geometry=concrete_tiers_4, Transform=transform_6)
xz_2 = XZPlane(Origin=end_10.Start)
pt_14 = Point(transform_7)
pdecon_9 = Deconstruct(Point=pt_14)  # -> XComponent, YComponent, ZComponent
crv_50 = Curve(transform_8)
item_5 = ListItem(List=xz_2, Index=0, Wrap=True)  # -> Item, Item1, Item2, Item3, Item4
sort_13 = SortList(Keys=pdecon_9.ZComponent, ValuesA=pt_14)  # -> Keys, ValuesA
end_11 = EndPoints(Curve=crv_50)  # -> Start, End
pdecon_10 = Deconstruct(Point=end_11.Start)  # -> XComponent, YComponent, ZComponent
Y_20 = UnitY(Factor=tier_extension_2)
sort_14 = SortList(Keys=pdecon_10.ZComponent, ValuesA=crv_50)  # -> Keys, reverse(ValuesA)
project_7 = Project(Geometry=sort_14.ValuesA, Plane=item_5.Item1)  # -> Geometry, Transform
project_8 = Project(Geometry=sort_14.ValuesA, Plane=item_5.Item3)  # -> Geometry, Transform
project_9 = Project(Geometry=sort_13.ValuesA, Plane=item_5.Item)  # -> Geometry, Transform
project_10 = Project(Geometry=sort_13.ValuesA, Plane=item_5.Item4)  # -> Geometry, Transform
project_11 = Project(Geometry=sort_13.ValuesA, Plane=item_5.Item1)  # -> Geometry, Transform
project_12 = Project(Geometry=sort_13.ValuesA, Plane=item_5.Item3)  # -> Geometry, Transform
neg_22 = Negative(Value=Y_20)
split_4 = SplitList(List=project_7.Geometry, Index=1)  # -> ListA, ListB
split_5 = SplitList(List=project_8.Geometry, Index=1)  # -> ListA, ListB
ln_2 = Line(StartPoint=project_9.Geometry, EndPoint=project_10.Geometry)
Z_9 = UnitZ(Factor="10")
neg_23 = Negative(Value=Z_9)
extr_5 = Extrude(Base=project_7.Geometry, Direction=neg_22)
extr_6 = Extrude(Base=project_8.Geometry, Direction=Y_20)
X_12 = UnitX(Factor="780")
move_13 = Move(Geometry=ln_2, Motion=neg_23)  # -> Geometry, Transform
cap_4 = CapHoles(Brep=extr_5)  # -> reverse(Brep)
cap_5 = CapHoles(Brep=extr_6)  # -> reverse(Brep)
loft_2 = Loft(
    Curves=[split_4.ListA, split_5.ListA],
    Options={Adjust=False, Closed=False, LoftEnds=0, LoftSimp=0, LoftType=0, Rebuild=10, Refit=0.01})
addition_7 = Addition(A=X_12, B=Z_9)
multiplication_4 = Multiplication(A=2, B=Z_9)
move_14 = Move(Geometry=move_13.Geometry, Motion=addition_7)  # -> Geometry, Transform
rulesrf_2 = RuledSurface(CurveA=move_13.Geometry, CurveB=move_14.Geometry)
extr_7 = Extrude(Base=rulesrf_2, Direction=multiplication_4)
sdiff_4 = SolidDifference(BrepsA=cap_4, BrepsB=extr_7)
sdiff_5 = SolidDifference(BrepsA=cap_5, BrepsB=extr_7)
edge_right = Point(project_11.Geometry)
edge_left = Point(project_12.Geometry)

transform_9 = Transform(Geometry=steps, Transform=transform_6)
split_6 = SplitList(List=reverse(project_8.Geometry), Index=1)  # -> ListA, ListB
split_7 = SplitList(List=reverse(project_7.Geometry), Index=1)  # -> ListA, ListB
project_13 = Project(Geometry=transform_9, Plane=item_5.Item1)  # -> Geometry, Transform
project_14 = Project(Geometry=transform_9, Plane=item_5.Item3)  # -> Geometry, Transform
loft_3 = Loft(
    Curves=[project_13.Geometry, project_14.Geometry],
    Options={Adjust=False, Closed=False, LoftEnds=0, LoftSimp=0, LoftType=0, Rebuild=10, Refit=0.01})
loft_4 = Loft(
    Curves=[split_7.ListA, split_6.ListA],
    Options={Adjust=False, Closed=False, LoftEnds=0, LoftSimp=0, LoftType=0, Rebuild=10, Refit=0.01})
transform_10 = Transform(Geometry=project_12.Geometry, Transform=move_14.Transform)
truss_start_2 = Point(project_11.Geometry)

concrete_tiers_5 = Brep(flatten([loft_2, sdiff_4, sdiff_5, loft_4, loft_3]))

top_left = Point(transform_10)
lng = ListLength(List=edge_left)
data_6 = Data(lng)
concrete_tiers_6 = Brep(concrete_tiers_5)
split_8 = SplitList(List=top_left, Index=data_6)  # -> ListA, ListB
split_9 = SplitList(List=edge_right, Index=data_6)  # -> ListA, ListB
split_10 = SplitList(List=edge_left, Index=data_6)  # -> ListA, ListB
preview_2 = CustomPreview(Geometry=concrete_tiers_6, Material=ColourSwatch(SwatchColor=RGB(171, 171, 171)))
ln_3 = Line(StartPoint=split_10.ListA, EndPoint=split_9.ListA)
yz = YZPlane(Origin=split_10.ListA)
pframe_4 = PerpFrame(Curve=ln_3, Parameter=0)
len_2 = Length(Curve=ln_3)
pframe_5 = PerpFrame(Curve=ln_3, Parameter=0.5)
bake_2 = BakeObjects(Geometry=concrete_tiers_6, Attributes=attributes_2, Bake=False)
pflip = FlipPlane(Plane=yz, ReverseX=True, ReverseY=False, SwapAxes=False)
align = AlignPlane(Plane=pframe_4, Direction=X_7)  # -> Plane, Angle
l_tr = Data(len_2)
crv_51 = Curve(ln_3)
orient_4 = Orient(Source=xy, Target=pflip)  # -> Geometry, Transform
pln = Plane(align.Plane)
transform_11 = Transform(orient_4.Transform)
orient_5 = Orient(Source=xy_2, Target=pln)  # -> Geometry, Transform
transform_12 = Transform(orient_5.Transform)
transform_13 = Transform(transform_11)
pln_2 = Plane(align.Plane)
pt_15 = Point(split_8.ListA)
extruder = Extruder(G=crv_19, T=transform_12, E="40", D=l_tr)
extruder_2 = Extruder(G=crv_20, T=transform_12, E="40", D=l_tr)
extruder_3 = Extruder(G=crv_21, T=transform_12, E=addition_4, D=l_tr)
extruder_4 = Extruder(G=crv_34, T=transform_12, E="5", D=l_tr)
extruder_5 = Extruder(G=crv_23, T=transform_12, E="5", D=l_tr)
extruder_6 = Extruder(G=crv_22, T=transform_12, E="5", D=l_tr)
pl_offset = PlaneOffset(BasePlane=graft(pln_2), Offset=panel_5)
extruder_7 = Extruder(G=crv_26, T=transform_12, E="10", D=l_tr)
extruder_8 = Extruder(G=crv_30, T=transform_12, E="10", D=l_tr)
extruder_9 = Extruder(G=crv_29, T=transform_12, E="10", D=l_tr)
transform_14 = Transform(Geometry=crv_42, Transform=graft(transform_12))
transform_15 = Transform(Geometry=pt_11, Transform=graft(transform_12))
extruder_10 = Extruder(G=crv_31, T=transform_12, E="10", D=l_tr)
transform_16 = Transform(Geometry=crv_38, Transform=graft(transform_12))
extruder_11 = Extruder(G=crv_32, T=transform_12, E="10", D=l_tr)
extruder_12 = Extruder(G=crv_33, T=transform_12, E="10", D=l_tr)
transform_17 = Transform(Geometry=crv_44, Transform=graft(transform_12))
transform_18 = Transform(Geometry=crv_39, Transform=graft(transform_12))
extruder_13 = Extruder(G=crv_35, T=transform_12, E="0", D="40")
cap_6 = CapHoles(Brep=graft(extruder))
cap_7 = CapHoles(Brep=graft(extruder_2))
transform_19 = Transform(Geometry=crv_45, Transform=graft(transform_12))
transform_20 = Transform(Geometry=crv_41, Transform=graft(transform_12))
transform_21 = Transform(Geometry=crv_43, Transform=graft(transform_13))
cap_8 = CapHoles(Brep=graft(extruder_3))
cap_9 = CapHoles(Brep=graft(extruder_4))
cap_10 = CapHoles(Brep=graft(extruder_5))
cap_11 = CapHoles(Brep=graft(extruder_6))
extruder_14 = Extruder(G=crv_37, T=transform_12, E="90", D=l_tr)
transform_22 = Transform(Geometry=pt_13, Transform=transform_12)  # -> graft(Geometry)
extruder_15 = Extruder(G=crv_36, T=transform_12, E="0", D="40")
transform_23 = Transform(Geometry=crv_40, Transform=transform_13)
cap_12 = CapHoles(Brep=graft(extruder_7))
transform_24 = Transform(Geometry=crv_40, Transform=transform_13)
transform_25 = Transform(Geometry=swp1, Transform=graft(transform_12))
cap_13 = CapHoles(Brep=graft(extruder_8))
cap_14 = CapHoles(Brep=graft(extruder_10))
cap_15 = CapHoles(Brep=graft(extruder_11))
cap_16 = CapHoles(Brep=graft(extruder_12))
cap_17 = CapHoles(Brep=graft(extruder_9))
move_15 = Move(Geometry=transform_21, Motion=X_8)  # -> Geometry, Transform
move_16 = Move(Geometry=pt_15, Motion=addition_6)  # -> Geometry, Transform
cap_18 = CapHoles(Brep=extruder_14)
data_7 = Data(extruder_13)
cap_19 = CapHoles(Brep=transform_25)
extr_8 = Extrude(Base=move_15.Geometry, Direction=X_9)
extruder_16 = Extruder(G=crv_46, T=transform_12, E="0", D="40")
transform_26 = Transform(Geometry=move_11.Geometry, Transform=graft(transform_12))
move_17 = Move(Geometry=transform_19, Motion=neg_4)  # -> Geometry, Transform
extruder_17 = Extruder(G=crv_47, T=transform_12, E="0", D="40")
extr_9 = Extrude(Base=transform_18, Direction=neg_8)
extr_10 = Extrude(Base=transform_17, Direction=neg_7)
extr_11 = Extrude(Base=transform_16, Direction=neg_5)
extr_12 = Extrude(Base=transform_20, Direction=neg_9)
extr_13 = Extrude(Base=transform_23, Direction=X_10)
transform_27 = Transform(Geometry=swp1_2, Transform=transform_12)  # -> graft(Geometry)
transform_28 = Transform(Geometry=swp1_3, Transform=transform_12)  # -> graft(Geometry)
flip = FlipMatrix(Data=cap_18)
dispatch_2 = Dispatch(List=cap_19, DispatchPattern=[True, False])  # -> ListA, ListB
brep = Brep(cap_9)
brep_2 = Brep(cap_11)
brep_3 = Brep(cap_10)
extr_14 = Extrude(Base=move_17.Geometry, Direction=neg_6)
yz_2 = YZPlane(Origin=move_16.Geometry)
move_18 = Move(Geometry=graft(extruder_15), Motion=neg_13)  # -> Geometry, Transform
move_19 = Move(Geometry=transform_14, Motion=neg_14)  # -> Geometry, Transform
move_20 = Move(Geometry=transform_15, Motion=neg_12)  # -> Geometry, Transform
cap_20 = CapHoles(Brep=extr_11)
xy_6 = XYPlane(Origin=move_16.Geometry)
move_21 = Move(Geometry=transform_27, Motion=neg_10)  # -> Geometry, Transform
cap_21 = CapHoles(Brep=extr_10)
cap_22 = CapHoles(Brep=extr_9)
move_22 = Move(Geometry=transform_28, Motion=neg_11)  # -> Geometry, Transform
sdiff_6 = SolidDifference(BrepsA=dispatch_2.ListA, BrepsB=dispatch_2.ListB)
sec = BrepPlane(Brep=brep_3, Plane=pl_offset)  # -> Curves, Points
cap_23 = CapHoles(Brep=extr_12)
sec_2 = BrepPlane(Brep=brep, Plane=pl_offset)  # -> Curves, Points
sec_3 = BrepPlane(Brep=brep_2, Plane=pl_offset)  # -> Curves, Points
move_23 = Move(Geometry=graft(extruder_13), Motion=neg_18)  # -> Geometry, Transform
move_24 = Move(Geometry=sdiff_6, Motion=neg_3)  # -> Geometry, Transform
cap_24 = CapHoles(Brep=extr_8)
move_25 = Move(Geometry=move_20.Geometry, Motion=Z_6)  # -> Geometry, Transform
cap_25 = CapHoles(Brep=extr_14)
cap_26 = CapHoles(Brep=extr_13)  # -> graft(Brep)
extr_15 = Extrude(Base=move_19.Geometry, Direction=neg_15)
move_26 = Move(Geometry=transform_22, Motion=neg_17)  # -> Geometry, Transform
pl_offset_2 = PlaneOffset(BasePlane=yz_2, Offset=neg_16)
dispatch_3 = Dispatch(List=cap_22, DispatchPattern=[True, False])  # -> ListA, ListB
trim = TrimTree(Tree=sec_2.Curves, Depth=1)
trim_2 = TrimTree(Tree=sec_3.Curves, Depth=1)
move_27 = Move(Geometry=transform_26, Motion=Z_8)  # -> Geometry, Transform
trim_3 = TrimTree(Tree=sec.Curves, Depth=1)
move_28 = Move(Geometry=transform_26, Motion=Z_7)  # -> Geometry, Transform
cap_27 = CapHoles(Brep=move_22.Geometry)
cap_28 = CapHoles(Brep=move_21.Geometry)
move_29 = Move(Geometry=graft(extruder_16), Motion=neg_19)  # -> Geometry, Transform
move_30 = Move(Geometry=graft(extruder_17), Motion=neg_19)  # -> Geometry, Transform
xy_7 = XYPlane(Origin=move_26.Geometry)
cap_29 = CapHoles(Brep=extr_15)
mirror = Mirror(Geometry=cap_26, Plane=pframe_5)  # -> Geometry, Transform
partition_2 = PartitionList(List=move_24.Geometry, Size=panel_9)
brep_4 = Brep(move_24.Geometry)
cyl = Cylinder(Base=pl_offset_2, Radius=division_4, Length=multiplication_3)
sdiff_7 = SolidDifference(BrepsA=dispatch_3.ListA, BrepsB=dispatch_3.ListB)
cap_30 = CapHoles(Brep=move_18.Geometry)
cap_31 = CapHoles(Brep=move_23.Geometry)
splitmul = SplitBrepMultiple(Brep=brep, Cutters=trim)
splitmul_2 = SplitBrepMultiple(Brep=brep_2, Cutters=trim_2)
splitmul_3 = SplitBrepMultiple(Brep=brep_3, Cutters=trim_3)
extruder_18 = Extruder(G=crv_48, T=transform_12, E=Slider(0, range=0..100), D=subtraction_7)
mirror_2 = Mirror(Geometry=cap_25, Plane=pframe_5)  # -> Geometry, Transform
extruder_19 = Extruder(G=crv_49, T=transform_12, E=Slider(0, range=0..100), D=subtraction_7)
mirror_3 = Mirror(Geometry=cap_24, Plane=pframe_5)  # -> Geometry, Transform
mirror_4 = Mirror(Geometry=cap_27, Plane=pframe_5)  # -> Geometry, Transform
mirror_5 = Mirror(Geometry=cap_21, Plane=pframe_5)  # -> Geometry, Transform
bbox = BoundingBox(Content=partition_2, Plane=PlaneXY(0, 0, 0), UnionBox=True)  # -> Box, Box_2
cap_32 = CapHoles(Brep=cyl)  # -> graft(Brep)
sdiff_8 = SolidDifference(BrepsA=cap_23, BrepsB=cap_32)
mirror_6 = Mirror(Geometry=cap_29, Plane=pframe_5)  # -> Geometry, Transform
cap_33 = CapHoles(Brep=move_29.Geometry)
inblock_2 = InsertBlock(BlockName="REF-3D-Seat post", SourcePlane=xy_7)
cap_34 = CapHoles(Brep=move_30.Geometry)
mirror_7 = Mirror(Geometry=sdiff_7, Plane=pframe_5)  # -> Geometry, Transform
mirror_8 = Mirror(Geometry=cap_20, Plane=pframe_5)  # -> Geometry, Transform
mirror_9 = Mirror(Geometry=sdiff_8, Plane=pframe_5)  # -> Geometry, Transform
inblock_3 = InsertBlock(BlockName="REDD-3D-Beam bolt", SourcePlane=move_20.Geometry)
data_8 = Data(extruder_18)
inblock_4 = InsertBlock(BlockName="REDD-3D-Beam bolt", SourcePlane=move_27.Geometry)
inblock_5 = InsertBlock(BlockName="REDD-3D-Nut", SourcePlane=move_25.Geometry)
cap_35 = CapHoles(Brep=splitmul)
cap_36 = CapHoles(Brep=splitmul_2)
data_9 = Data(extruder_19)
cap_37 = CapHoles(Brep=splitmul_3)
inblock_6 = InsertBlock(BlockName="REDD-3D-Nut", SourcePlane=move_28.Geometry)
volume = Volume(Geometry=bbox.Box)  # -> Volume, Centroid
inblock_7 = InsertBlock(BlockName="REDD-3D-Hole", SourcePlane=xy_6)
inblock_8 = InsertBlock(BlockName="REDD-3D-M16_anchor", SourcePlane=xy_6)
move_31 = Move(Geometry=data_8, Motion=neg_20)  # -> Geometry, Transform
sift = SiftPattern(List=inblock_2, SiftPattern=panel_10)  # -> Output0, Output1, Output2
move_32 = Move(Geometry=data_9, Motion=neg_20)  # -> Geometry, Transform
deblock_2 = DeconstructBlock(Block=inblock_2)  # -> Name, Plane, Geometry
transform_29 = Transform(Geometry=sdiff_3, Transform=graft(transform_12))
rotate = Rotate(Geometry=inblock_8, Angle=-1.570796327, Plane=xy_6)  # -> Geometry, Transform
scale_nu = ScaleNU(Geometry=bbox.Box, Plane=volume.Centroid, ScaleX="2", ScaleY=1, ScaleZ="2")  # -> Geometry, Transform
rotate_2 = Rotate(Geometry=inblock_7, Angle=-1.570796327, Plane=xy_6)  # -> Geometry, Transform
flip_2 = FlipMatrix(Data=move_31.Geometry)
flip_3 = FlipMatrix(Data=move_32.Geometry)
trim_4 = TrimTree(Tree=deblock_2.Geometry, Depth=1)
trim_5 = TrimTree(Tree=scale_nu.Geometry, Depth=1)
mirror_10 = Mirror(Geometry=inblock_5, Plane=pframe_5)  # -> Geometry, Transform
mirror_11 = Mirror(Geometry=inblock_3, Plane=pframe_5)  # -> Geometry, Transform
sdiff_9 = SolidDifference(BrepsA=transform_29, BrepsB=[cap_26, mirror.Geometry])
mirror_12 = Mirror(Geometry=inblock_6, Plane=pframe_5)  # -> Geometry, Transform
move_33 = Move(Geometry=rotate.Geometry, Motion=X_11)  # -> Geometry, Transform
mirror_13 = Mirror(Geometry=inblock_4, Plane=pframe_5)  # -> Geometry, Transform
cap_38 = CapHoles(Brep=flip_2)
mirror_14 = Mirror(Geometry=rotate_2.Geometry, Plane=pframe_5)  # -> Geometry, Transform
cap_39 = CapHoles(Brep=flip_3)
brep_5 = Brep(trim_5)
sdiff_10 = SolidDifference(BrepsA=cap_17, BrepsB=brep_5)
sdiff_11 = SolidDifference(BrepsA=cap_12, BrepsB=brep_5)
mirror_15 = Mirror(Geometry=move_33.Geometry, Plane=pframe_5)  # -> Geometry, Transform
brep_6 = Brep(sdiff_9)
brep_7 = Brep([cap_25, mirror_2.Geometry])
brep_8 = Brep([cap_29, mirror_6.Geometry])
brep_9 = Brep([cap_24, mirror_3.Geometry])
brep_10 = Brep([sdiff_7, mirror_7.Geometry])
brep_11 = Brep([cap_20, mirror_8.Geometry])
data_10 = Data(trim_4)
brep_12 = Brep(cap_35)
brep_13 = Brep(cap_36)
brep_14 = Brep(cap_37)
brep_15 = Brep(cap_31)
brep_16 = Brep(cap_8)
brep_17 = Brep(cap_6)
brep_18 = Brep(cap_7)
brep_19 = Brep([cap_27, mirror_4.Geometry])
brep_20 = Brep(cap_33)
brep_21 = Brep(cap_16)
brep_22 = Brep(cap_15)
brep_23 = Brep(cap_14)
brep_24 = Brep(sdiff_10)
brep_25 = Brep(sdiff_11)
brep_26 = Brep(cap_13)
brep_27 = Brep(cap_38)
brep_28 = Brep(cap_39)
brep_29 = Brep(flip)
brep_30 = Brep([cap_21, mirror_5.Geometry])
brep_31 = Brep([sdiff_8, mirror_9.Geometry])
brep_32 = Brep(cap_30)
brep_33 = Brep(cap_28)
brep_34 = Brep(brep_4)
brep_35 = Brep(cap_34)
data_11 = Data([inblock_5, mirror_10.Geometry])
data_12 = Data([move_33.Geometry, mirror_15.Geometry])
data_13 = Data([inblock_3, mirror_11.Geometry])
data_14 = Data([rotate_2.Geometry, mirror_14.Geometry])
data_15 = Data([inblock_6, mirror_12.Geometry])
data_16 = Data([inblock_4, mirror_13.Geometry])
merge_3 = Merge(Data1=data_15, Data2=data_16, Data3=data_11, Data4=data_13, Data5=data_14, Data6=data_12)
cluster = Cluster(G=brep_6, P=expression, T=mode, V=vec.Vector)
cluster_2 = Cluster(G=brep_7, P=expression, T=mode, V=vec.Vector)
cluster_3 = Cluster(G=brep_29, P=expression, T=mode, V=vec.Vector)
cluster_4 = Cluster(G=brep_30, P=expression, T=mode, V=vec_2.Vector)
cluster_5 = Cluster(G=brep_8, P=expression, T=mode, V=vec_2.Vector)
cluster_6 = Cluster(G=brep_9, P=expression, T=mode, V=vec_2.Vector)
cluster_7 = Cluster(G=brep_31, P=expression, T=mode, V=vec_2.Vector)
cluster_8 = Cluster(G=brep_10, P=expression, T=mode, V=vec_2.Vector)
cluster_9 = Cluster(G=brep_11, P=expression, T=mode, V=vec_2.Vector)
cluster_10 = Cluster(G=data_10, P=expression, T=mode, V=vec_7)
cluster_11 = Cluster(G=brep_12, P=expression, T=mode, V=vec_7)
cluster_12 = Cluster(G=brep_13, P=expression, T=mode, V=vec_7)
cluster_13 = Cluster(G=brep_14, P=expression, T=mode, V=vec_7)
cluster_14 = Cluster(G=brep_32, P=expression, T=mode, V=vec_7)
cluster_15 = Cluster(G=brep_15, P=expression, T=mode, V=vec_7)
cluster_16 = Cluster(G=brep_16, P=expression, T=mode, V=vec_5.Vector)
cluster_17 = Cluster(G=brep_17, P=expression, T=mode, V=vec_5.Vector)
cluster_18 = Cluster(G=brep_18, P=expression, T=mode, V=vec_5.Vector)
cluster_19 = Cluster(G=brep_19, P=expression, T=mode, V=vec_5.Vector)
cluster_20 = Cluster(G=brep_33, P=expression, T=mode, V=vec_5.Vector)
cluster_21 = Cluster(G=brep_20, P=expression, T=mode, V=vec_5.Vector)
cluster_22 = Cluster(G=brep_35, P=expression, T=mode, V=vec_5.Vector)
cluster_23 = Cluster(G=brep_21, P=expression, T=mode, V=vec_6.Vector)
cluster_24 = Cluster(G=brep_22, P=expression, T=mode, V=vec_6.Vector)
cluster_25 = Cluster(G=brep_23, P=expression, T=mode, V=vec_6.Vector)
cluster_26 = Cluster(G=brep_24, P=expression, T=mode, V=vec_6.Vector)
cluster_27 = Cluster(G=brep_25, P=expression, T=mode, V=vec_6.Vector)
cluster_28 = Cluster(G=brep_26, P=expression, T=mode, V=vec_6.Vector)
cluster_29 = Cluster(G=brep_34, P=expression, T=mode, V=vec_6.Vector)
cluster_30 = Cluster(G=brep_27, P=expression, T=mode, V=vec_6.Vector)
cluster_31 = Cluster(G=brep_28, P=expression, T=mode, V=vec_6.Vector)
preview_3 = CustomPreview(Geometry=data_15, Material=swatch_10)
preview_4 = CustomPreview(Geometry=data_16, Material=swatch_10)
preview_5 = CustomPreview(Geometry=data_11, Material=swatch_10)
preview_6 = CustomPreview(Geometry=data_13, Material=swatch_10)
preview_7 = CustomPreview(Geometry=data_14, Material=swatch_10)
preview_8 = CustomPreview(Geometry=data_12, Material=swatch_10)
preview_9 = CustomPreview(Geometry=cluster_2, Material=swatch_4)
preview_10 = CustomPreview(Geometry=cluster_3, Material=swatch_4)
preview_11 = CustomPreview(Geometry=cluster_4, Material=swatch_6)
preview_12 = CustomPreview(Geometry=cluster_5, Material=swatch_6)
preview_13 = CustomPreview(Geometry=cluster_6, Material=swatch_6)
preview_14 = CustomPreview(Geometry=cluster_7, Material=swatch_6)
preview_15 = CustomPreview(Geometry=cluster_8, Material=swatch_6)
preview_16 = CustomPreview(Geometry=cluster_9, Material=swatch_6)
preview_17 = CustomPreview(Geometry=cluster_10, Material=swatch_7)
preview_18 = CustomPreview(Geometry=cluster_11, Material=swatch_2)
preview_19 = CustomPreview(Geometry=cluster_12, Material=swatch_7)
preview_20 = CustomPreview(Geometry=cluster_13, Material=swatch_7)
preview_21 = CustomPreview(Geometry=cluster_14, Material=swatch_7)
preview_22 = CustomPreview(Geometry=cluster_15, Material=swatch_7)
preview_23 = CustomPreview(Geometry=cluster_16, Material=swatch_8)
preview_24 = CustomPreview(Geometry=cluster_17, Material=swatch_3)
preview_25 = CustomPreview(Geometry=cluster_18, Material=swatch_3)
preview_26 = CustomPreview(Geometry=cluster_19, Material=swatch_3)
preview_27 = CustomPreview(Geometry=cluster_20, Material=swatch_3)
preview_28 = CustomPreview(Geometry=cluster_21, Material=swatch_3)
preview_29 = CustomPreview(Geometry=cluster_22, Material=swatch_3)
preview_30 = CustomPreview(Geometry=cluster_23, Material=swatch_9)
preview_31 = CustomPreview(Geometry=cluster_24, Material=swatch_5)
preview_32 = CustomPreview(Geometry=cluster_25, Material=swatch_5)
preview_33 = CustomPreview(Geometry=cluster_26, Material=swatch_5)
preview_34 = CustomPreview(Geometry=cluster_27, Material=swatch_5)
preview_35 = CustomPreview(Geometry=cluster_28, Material=swatch_5)
preview_36 = CustomPreview(Geometry=cluster_30, Material=swatch_5)
preview_37 = CustomPreview(Geometry=cluster_31, Material=swatch_5)
preview_38 = CustomPreview(Geometry=cluster_29, Material=swatch_5)
aluminium = CustomPreview(Geometry=cluster, Material=swatch)
merge_4 = Merge(Data1=cluster_2, Data2=cluster_3)
merge_5 = Merge(Data1=cluster_4, Data2=cluster_5, Data3=cluster_6, Data4=cluster_7, Data5=cluster_8, Data6=cluster_9)
merge_6 = Merge(
    Data1=cluster_24,
    Data2=cluster_25,
    Data3=cluster_26,
    Data4=cluster_27,
    Data5=cluster_28,
    Data6=cluster_29,
    Data7=cluster_30,
    Data8=cluster_31)
merge_7 = Merge(Data1=cluster_17, Data2=cluster_18, Data3=cluster_19, Data4=cluster_20, Data5=cluster_21, Data6=cluster_22)
merge_8 = Merge(Data1=cluster_10, Data2=cluster_12, Data3=cluster_13, Data4=cluster_14, Data5=cluster_15)
item_6 = ListItem(List=flatten(cluster), Index=Slider(0, range=0..1), Wrap=True)
bake_3 = BakeObjects(Geometry=cluster, Attributes=attributes_4, Bake=False)
bake_4 = BakeObjects(Geometry=merge_3, Attributes=attributes_6, Bake=False)
bake_5 = BakeObjects(Geometry=merge_4, Attributes=attributes_5, Bake=False)
bake_6 = BakeObjects(Geometry=cluster_16, Attributes=attributes_3, Bake=False)
bake_7 = BakeObjects(Geometry=merge_5, Attributes=attributes_7, Bake=False)
volume_2 = Volume(Geometry=cluster_16)  # -> Volume, Centroid
bake_8 = BakeObjects(Geometry=merge_7, Attributes=attributes_8, Bake=False)
volume_3 = Volume(Geometry=merge_7)  # -> Volume, Centroid
bake_9 = BakeObjects(Geometry=merge_8, Attributes=attributes_9, Bake=False)
bake_10 = BakeObjects(Geometry=merge_6, Attributes=attributes_12, Bake=False)
bake_11 = BakeObjects(Geometry=cluster_11, Attributes=attributes_10, Bake=False)
bake_12 = BakeObjects(Geometry=cluster_23, Attributes=attributes_11, Bake=False)
ma = MassAddition(Input=volume_2.Volume)  # -> Result, PartialResults
ma_2 = MassAddition(Input=volume_3.Volume)  # -> Result, PartialResults
volume_4 = Volume(Geometry=cluster_11)  # -> Volume, Centroid
volume_5 = Volume(Geometry=merge_8)  # -> Volume, Centroid
volume_6 = Volume(Geometry=cluster_23)  # -> Volume, Centroid
volume_7 = Volume(Geometry=merge_6)  # -> Volume, Centroid
expression_2 = Expression(x="225", y=ma.Result, Expression="x*y/1e9")
expression_3 = Expression(x="2700", y=ma_2.Result, Expression="x*y/1e9")
ma_3 = MassAddition(Input=volume_4.Volume)  # -> Result, PartialResults
ma_4 = MassAddition(Input=volume_5.Volume)  # -> Result, PartialResults
ma_5 = MassAddition(Input=volume_6.Volume)  # -> Result, PartialResults
ma_6 = MassAddition(Input=volume_7.Volume)  # -> Result, PartialResults
expression_4 = Expression(x="1000", y=ma_3.Result, Expression="x*y/1e9")
expression_5 = Expression(x="7850", y=ma_4.Result, Expression="x*y/1e9")
addition_8 = Addition(A=expression_2, B=expression_3)
expression_6 = Expression(x="225", y=ma_5.Result, Expression="x*y/1e9")
expression_7 = Expression(x="2700", y=ma_6.Result, Expression="x*y/1e9")
panel_11 = Panel(addition_8)
addition_9 = Addition(A=expression_4, B=expression_5)
addition_10 = Addition(A=expression_6, B=expression_7)
division_5 = Division(A=addition_9, B=3)
panel_12 = Panel(addition_10)
panel_13 = Panel(division_5)

# ==== cluster Extruder
E = ClusterInput()
D = ClusterInput()
E_2 = Data(E)
D_2 = Data(D)
G = ClusterInput()
T = ClusterInput()
neg = Negative(Value=E_2)
expression = Expression(x=E_2, y=D_2, Expression="y-2*x")
transform = Transform(Geometry=G, Transform=T)
Y = UnitY(Factor=neg)
move = Move(Geometry=transform, Motion=Y)  # -> Geometry, Transform
neg_2 = Negative(Value=expression)
Y_2 = UnitY(Factor=neg_2)
extr = Extrude(Base=move.Geometry, Direction=Y_2)
E_3 = ClusterOutput(extr)

# ==== cluster Cluster
V = ClusterInput()
G = ClusterInput()
T = ClusterInput()
P = ClusterInput()
G_2 = Geometry(G)
T_2 = Data(T)
P_2 = Data(P)
V_2 = Vector(V)
split = SplitTree(Data=simplify(G_2), Masks=flatten(P_2))  # -> Positive, Negative
branch = TreeBranch(Tree=simplify(G_2), Path=P_2, MaintainPaths=True)
move = Move(Geometry=split.Positive, Motion=V_2)  # -> Geometry, Transform
filter = StreamFilter(Gate=T_2, Stream0=G_2, Stream1=split.Positive, Stream2=[move.Geometry, split.Negative])
simplify = SimplifyTree(Tree=filter, Front=False)
geo = Geometry(simplify)
geo_2 = ClusterOutput(geo)
